% Requirement links of PulsedSineWave.m (R2025a)

% line 6 relates to PulsedSineWaveRequirements.slreqx#1
    properties % Configurable wave parameters

% lines 7-8 implements PulsedSineWaveRequirements.slreqx#2
        % Amplitude of the sine wave.
        Amplitude(1, 1) double {mustBeFinite, mustBeNonnegative} = 1.1

% lines 9-10 implements PulsedSineWaveRequirements.slreqx#3
        % Frequency of the sine wave (Hz).
        Frequency(1, 1) double {mustBeFinite, mustBeNonnegative} = 1000

% lines 11-12 implements PulsedSineWaveRequirements.slreqx#4
        % Phase of the sine wave (radians).
        Phase(1, 1) double {mustBeReal, mustBeFinite} = 0

% lines 13-14 implements PulsedSineWaveRequirements.slreqx#5
        % Signal duration (s).
        Duration(1, 1) double {mustBeFinite, mustBePositive} = 2

% lines 15-16 implements PulsedSineWaveRequirements.slreqx#6
        % Pulse rate (Hz), used to create a pulsed signal.
        PulseRate(1, 1) double {mustBeFinite, mustBePositive} = 4

% lines 17-18 implements PulsedSineWaveRequirements.slreqx#7
        % Duty cycle period (%), used to create a pulsed signal.
        Duty(1, 1) double {mustBeFinite, mustBeInRange( Duty, 0, 100 )} = 30

% lines 19-20 implements PulsedSineWaveRequirements.slreqx#8
        % Signal sampling frequency (Hz).
        SampleRate(1, 1) double {mustBeFinite, mustBePositive} = 8000

% line 23 relates to PulsedSineWaveRequirements.slreqx#9
    properties ( Dependent, SetAccess = private )

% lines 24-25 implements PulsedSineWaveRequirements.slreqx#10
        % Signal time step (s).
        TimeStep

% lines 26-27 implements PulsedSineWaveRequirements.slreqx#11
        % Timetable comprising the time base and the signal values.
        Signal

% lines 32-44 implements PulsedSineWaveRequirements.slreqx#12
        function obj = PulsedSineWave( namedArgs )
            %SIGNAL Construct a pulsed sine wave object.

            arguments ( Input )
                namedArgs.?PulsedSineWave
            end % arguments ( Input )

            namedArgs = namedargs2cell( namedArgs );
            for k = 1 : 2 : numel( namedArgs )
                obj.(namedArgs{k}) = namedArgs{k+1};
            end % for

        end % constructor

% lines 46-50 implements PulsedSineWaveRequirements.slreqx#10
        function value = get.TimeStep( obj )

            value = obj.Signal.Properties.TimeStep;

        end % get.TimeStep

% lines 52-69 implements PulsedSineWaveRequirements.slreqx#11
% lines 52-69 implements PulsedSineWaveRequirements.slreqx#13
        function value = get.Signal( obj )

            % Compute the sine wave, pulses, and the pulsed sine wave.
            A = obj.Amplitude;
            f = obj.Frequency;
            ph = obj.Phase;            
            dr = obj.Duration;           
            r = obj.PulseRate;
            d = obj.Duty;
            fs = obj.SampleRate;
            [PulsedSineWave, Time] = ...
                generateWave( A, f, ph, dr, r, d, fs );            

            % Assemble the timetable.
            Time = seconds( Time );
            value = timetable( Time, PulsedSineWave );

        end % get.Signal

% lines 62-63 implements PulsedSineWaveRequirements.slreqx#11
% lines 62-63 implements PulsedSineWaveRequirements.slreqx#13
            [PulsedSineWave, Time] = ...
                generateWave( A, f, ph, dr, r, d, fs );

% line 66 implements PulsedSineWaveRequirements.slreqx#11
% line 66 implements PulsedSineWaveRequirements.slreqx#13
            Time = seconds( Time );

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