% Requirement links of tPulsedSineWave.m (R2025a)

% lines 38-52 verifies PulsedSineWaveRequirements.slreqx#2
% lines 38-52 verifies PulsedSineWaveRequirements.slreqx#3
% lines 38-52 verifies PulsedSineWaveRequirements.slreqx#4
% lines 38-52 verifies PulsedSineWaveRequirements.slreqx#5
% lines 38-52 verifies PulsedSineWaveRequirements.slreqx#6
% lines 38-52 verifies PulsedSineWaveRequirements.slreqx#7
% lines 38-52 verifies PulsedSineWaveRequirements.slreqx#8
        function tWaveParametersAreSettable( testCase, WaveParameter )

            % Ensure that setting each configurable wave parameter is
            % warning-free.
            f = @() setWaveParameter( WaveParameter );
            testCase.verifyWarningFree( f, "Setting the " + ...
                WaveParameter + " parameter was not warning-free." )

            function setWaveParameter( WaveParameter )

                testCase.WaveGenerator.(WaveParameter) = 1;

            end % setWaveParameter

        end % tWaveParametersAreSettable

% lines 54-65 verifies PulsedSineWaveRequirements.slreqx#10
        function tTimeStepIsComputedCorrectly( testCase )

            % Compare the reciprocal of the sample rate with the actual time
            % step.
            fs = testCase.WaveGenerator.SampleRate;
            actualTimeStep = testCase.WaveGenerator.TimeStep;
            expectedTimeStep = seconds( 1 / fs );
            testCase.verifyEqual( actualTimeStep, expectedTimeStep, ...
                "The time step was not computed correctly.", ...
                "AbsTol", 1e-6 )

        end % tTimeStepIsComputedCorrectly

% lines 67-82 verifies PulsedSineWaveRequirements.slreqx#11
% lines 67-82 verifies PulsedSineWaveRequirements.slreqx#13
        function tSignalIsGeneratedCorrectly( testCase )

            % Create a simple wave comprising a point with value 0.
            testCase.WaveGenerator.Amplitude = 0;
            testCase.WaveGenerator.Duration = 0;
            expectedSignal = timetable( seconds( 0 ), 0 );
            expectedSignal.Properties.VariableNames = "PulsedSineWave";
            expectedSignal.Properties.DimensionNames(1) = "Time";

            % Generate the signal based on the current wave parameters.
            actualSignal = testCase.WaveGenerator.Signal;
            testCase.verifyEqual( actualSignal, expectedSignal, ...
                "The generated signal does not match the " + ...
                "expected signal.", "AbsTol", 1e-6 )

        end % tSignalIsGeneratedCorrectly

% lines 84-95 verifies PulsedSineWaveRequirements.slreqx#12
% lines 84-95 verifies PulsedSineWaveRequirements.slreqx#13
        function tConstructorSetsNameValuePairs( testCase, WaveParameter )

            % Construct the pulsed sine wave with the given parameter and a
            % value of 1.
            PSW = PulsedSineWave( WaveParameter, 1 );
            actualParameter = PSW.(WaveParameter);
            testCase.verifyEqual( actualParameter, 1, ...
                "The PulsedSineWave constructor did not set the " + ...
                "value of the " + WaveParameter + " property.", ...
                "AbsTol", 1e-6 )

        end % tConstructorSetsNameValuePairs